# Dynamo graph EXCEL.dyn (Dynamo 2.16.2.5624)

# group: 1. EXPORTADO BASICO EXCEL
file_path = Filename("D:\CLASE 10\EXPORTACION v2.xlsx")
code_block = CodeBlock { "Hoja1"; }
code_block_2 = CodeBlock { 1; }
code_block_3 = CodeBlock { 0; }
code_block_4 = CodeBlock { nombres = ["Elemento 1", "Elemento 2", "Elemento 3"]; }
code_block_5 = CodeBlock { areas = [10.5, 15.8, 20.2]; }
list_create = List.Create(item0=code_block_4, item1=code_block_5)
transpose = List.Transpose(lists=list_create)
exportToExcel = Data.ExportToExcel(filePath=file_path, sheetName=code_block, startRow=code_block_2, startColumn=code_block_3, data=transpose)  # frozen

# group: 2. IMPORTAR DATA EXCEL
file_path_2 = Filename("D:\CLASE 10\EXPORTACION v2.xlsx")
file_from_path = FileObject(path=file_path_2)
code_block_6 = CodeBlock { "Hoja1"; }
importExcel = Data.ImportExcel(file=file_from_path, sheetName=code_block_6)
transpose_2 = List.Transpose(lists=importExcel)
code_block_7 = CodeBlock { 0; }
removeItemAtIndex = List.RemoveItemAtIndex(indices=code_block_7)  # unwired: list
map = List.Map(list=transpose_2, function=removeItemAtIndex)

# group: 3. EXPORTAR DATA REVIT
file_path_3 = Filename("D:\CLASE 10\INFORMACION.xlsx")
code_block_8 = CodeBlock { "Hoja1"; }
code_block_9 = CodeBlock { 0; }
categories = Categories("OST_Windows")
all_elements_of_category = ElementsOfCategory(Category=categories)
code_block_10 = CodeBlock(A=all_elements_of_category) { A.Name; }
id = Element.Id(element=all_elements_of_category)
code_block_11 = CodeBlock { ["Height", "Width"]; }
getParameterValueByName = Element.GetParameterValueByName(element=all_elements_of_category, parameterName=code_block_11, lacing=CrossProduct)
addItemToEnd = List.AddItemToEnd(item=id, list=getParameterValueByName, lacing=Longest)
addItemToFront = List.AddItemToFront(item=code_block_10, list=addItemToEnd, lacing=Longest)
exportToExcel_2 = Data.ExportToExcel(filePath=file_path_3, sheetName=code_block_8, startRow=code_block_9, startColumn=code_block_9, data=addItemToFront)

# group: 4. IMPORTAR SET PARAMETER EXCEL
file_path_4 = Filename("D:\CLASE 10\INFORMACION.xlsx")
file_from_path_2 = FileObject(path=file_path_4)
code_block_12 = CodeBlock { "Hoja1"; }
importExcel_2 = Data.ImportExcel(file=file_from_path_2, sheetName=code_block_12)
transpose_3 = List.Transpose(lists=importExcel_2)
code_block_13 = CodeBlock(A=transpose_3) { A[3]; }
code_block_14 = CodeBlock(ids=code_block_13) { elements = ElementSelector.ByElementId(ids); }
code_block_15 = CodeBlock { "Width"; }
code_block_16 = CodeBlock(A=transpose_3) { A[2]; }
setParameterByName = Element.SetParameterByName(element=code_block_14, parameterName=code_block_15, value=code_block_16)
code_block_17 = CodeBlock { "Height"; }
