# Dynamo graph ID DE ELEMENTO_EJEMPLO.dyn (Dynamo 2.16.2.5624)

all_elements_in_active_view = ElementsInView()
code_block = CodeBlock { "ID DE ELEMENTO"; }
id = Element.Id(element=all_elements_in_active_view)
string_from_object = FromObject(obj=id)
setParameterByName = Element.SetParameterByName(element=all_elements_in_active_view, parameterName=code_block, value=string_from_object)
