# Dynamo graph ID DE ELEMENTO.dyn (Dynamo 2.19.3.6394)

all_elements_in_active_view = ElementsInView()
parametro_nombre = StringInput("ID DE ELEMENTO")  # graph input
id = Element.Id(element=all_elements_in_active_view)
string_from_object = FromObject(obj=id)
setParameterByName = Element.SetParameterByName(element=all_elements_in_active_view, parameterName=parametro_nombre, value=string_from_object)
