# Dynamo graph Clase 5.dyn (Dynamo 2.16.2.5624)

# group: TIPOS DE DATOS EN DYNAMO
number = DoubleInput(6.7)
watch = Watch(number)
integer_slider = IntegerSlider(30, range=0..30 step 5)
number_slider = DoubleSlider(67.2, range=0..100 step 5.6)
string = StringInput("HOLA MUNDO")
boolean = BoolSelector(false)
watch_2 = Watch(boolean)

code_block = CodeBlock { 10; }
code_block_2 = CodeBlock { 5; }
sub = code_block - code_block_2
code_block_3 = CodeBlock { 5; }
div = sub / code_block_3
code_block_4 = CodeBlock { (10-5)/5; }
code_block_5 = CodeBlock { 0; }
code_block_6 = CodeBlock { 10; }
code_block_7 = CodeBlock { 3; }
sequence = Sequence(start=code_block_5, amount=code_block_6, step=code_block_7)

# group: NODOS RELACIONADOS STRING
code_block_8 = CodeBlock { "CLASE 05"; }
watch_3 = Watch(code_block_8)
code_block_9 = CodeBlock { "Elemento 1"; }
code_block_10 = CodeBlock { "No contiene"; }
list_create = List.Create(item0=code_block_9, item1=code_block_10)
code_block_11 = CodeBlock { "Elemento"; }
contains = String.Contains(string=list_create, searchFor=code_block_11)
code_block_12 = CodeBlock { "Elemento 1"; }
eq = list_create == code_block_12
code_block_13 = CodeBlock { "TEXTO 1 "; }
code_block_14 = CodeBlock { "TEXTO 2"; }
code_block_15 = CodeBlock(A=code_block_13, B=code_block_14) { A+B; }
concat = String.Concat(string0=code_block_13, string1=code_block_14)

code_block_16 = CodeBlock { 0; }
code_block_17 = CodeBlock { 10; }
code_block_18 = CodeBlock { 3; }
ELEVACIONES = Sequence(start=code_block_16, amount=code_block_17, step=code_block_18)
code_block_19 = CodeBlock { "NIVEL "; }
code_block_20 = CodeBlock { 1; }
code_block_21 = CodeBlock { 10; }
sequence_2 = Sequence(start=code_block_20, amount=code_block_21)
code_block_22 = CodeBlock(A=code_block_19, B=sequence_2) { A+B; }
byElevationAndName = Level.ByElevationAndName(elevation=ELEVACIONES, name=code_block_22)
