# Dynamo graph Suelosambientes_script.dyn (Dynamo 2.16.2.5624)
# packages: Data-Shapes 2022.2.100, Data-Shapes 2021.2.94, Clockwork for Dynamo 2.x 2.6.0, Data-Shapes 2022.2.96, Clockwork for Dynamo 2.x 2.3.0

code_block = CodeBlock { "Creacion de Suelos por Room"; }
file_path = Filename("C:\Users\oscar\Desktop\CODIFICACION EXCEL\índice.jpg")
code_block_2 = CodeBlock { "OK"; }
boolean = BoolSelector(true)

# group: INPUTS I - NIVEL
code_block_3 = CodeBlock { "Creacion de Suelos por Room"; }
file_path_2 = Filename("C:\Users\oscar\Desktop\CODIFICACION EXCEL\índice.jpg")
code_block_4 = CodeBlock { "OK"; }
code_block_5 = CodeBlock { "Seleccionar Nivel"; }
categories = Categories("OST_Levels")
all_elements_of_category = ElementsOfCategory(Category=categories)
name = Level.Name(level=all_elements_of_category)
dropdown_data = Custom[DropDown Data](InputName=code_block_5, Keys=name, Values=all_elements_of_category)  # package Data-Shapes
list_create = List.Create(item0=dropdown_data)
multipleinputform = Custom[MultipleInputForm ++](Description_optional=code_block_3, Logo_optional=file_path_2, ButtonText_optional=code_block_4, Inputs=list_create, Toggle=boolean)  # package Data-Shapes

code_block_6 = CodeBlock()
# ---------- code_block_6.designscript (2 lines) ----------
"La puerta esta en dirección
del ambiente?";
# ----------------------------------------
code_block_7 = CodeBlock { true; }
boolean_input = Custom[Boolean input](InputName=code_block_6, DefaultValue=code_block_7)  # package Data-Shapes

# group: INTERFAZ GRAFICA
code_block_8 = CodeBlock { "Escoger Ambientes"; }
code_block_9 = CodeBlock(A=multipleinputform.User_Inputs) { A[0]; }
all_elements_at_level = ElementsAtLevel(Level=code_block_9)
getCategory = Element.GetCategory(element=all_elements_at_level)
string_from_object = FromObject(object=getCategory)
categories_2 = Categories("OST_Rooms")
string_from_object_2 = FromObject(object=categories_2)
eq = string_from_object == string_from_object_2
filterByBoolMask = List.FilterByBoolMask(list=all_elements_at_level, mask=eq)
name_2 = Room.Name(room=filterByBoolMask.in)
listview_data = Custom[Listview Data](InputName=code_block_8, Keys=name_2, Values=filterByBoolMask.in)  # package Data-Shapes
code_block_10 = CodeBlock { "Escoger tipo de Suelo"; }
element_types = ElementTypes("FloorType")
all_elements_of_type = ElementsOfType(element_type=element_types)
code_block_11 = CodeBlock(A=all_elements_of_type) { A.Name; }
dropdown_data_2 = Custom[DropDown Data](InputName=code_block_10, Keys=code_block_11, Values=all_elements_of_type)
code_block_12 = CodeBlock()
# ---------- code_block_12.designscript (2 lines) ----------
"Colocar nombre del parametro
en el room";
# ----------------------------------------
code_block_13 = CodeBlock { "Acabado del suelo"; }
textbox_data = Custom[TextBox Data](InputName=code_block_12, DefaultText=code_block_13)  # package Data-Shapes
list_create_2 = List.Create(item0=listview_data, item1=dropdown_data_2, item2=textbox_data, item3=boolean_input)

multipleinputform_2 = Custom[MultipleInputForm ++](Description_optional=code_block, Logo_optional=file_path, ButtonText_optional=code_block_2, Inputs=list_create_2, Toggle=boolean)
code_block_14 = CodeBlock(A=multipleinputform_2.User_Inputs) { A[0]; A[1]; A[2]; A[3]; }
watch = Watch(code_block_14.out0)
flatten = List.Flatten(list=code_block_14.out0)
firstItem = List.FirstItem(list=flatten)
code_block_15 = CodeBlock(ROOM=firstItem) { ROOM; }

# group: PUERTAS
select_phase = RevitPhases()  # nothing selected
doors = Custom[Room.Doors](room=code_block_15, phase=select_phase)  # package Clockwork for Dynamo 2.x
flatten_2 = List.Flatten(list=doors)

string_from_object_3 = FromObject(object=code_block_14.out3)
python_script = Python()  # IronPython2; unwired: IN[0]
# ---------- python_script.python (22 lines) ----------
# Carga las bibliotecas de DesignScript y normas de Python.
import sys
import clr
clr.AddReference('ProtoGeometry')
from Autodesk.DesignScript.Geometry import *
clr.AddReference('RevitServices')
from RevitServices.Persistence import DocumentManager

# Las entradas de este

doc = DocumentManager.Instance.CurrentDBDocument

A = doc.Application.Language

B= str(A)

# Code 

if B == "Spanish": 
	OUT = "Anchura"
else:
	OUT = "Width"
# ----------------------------------------

# group: DATOS DE ENTRADA
getHost = FamilyInstance.GetHost(familyInstance=flatten_2)
elementType = Element.ElementType(element=getHost)
getParameterValueByName = Element.GetParameterValueByName(element=elementType, parameterName=python_script)
elementType_2 = Element.ElementType(element=flatten_2)
getParameterValueByName_2 = Element.GetParameterValueByName(element=elementType_2, parameterName=python_script)
code_block_16 = CodeBlock(w=getParameterValueByName_2) { w/2; Vector.ZAxis(); 90; }

python_script_2 = Python(IN[0]=string_from_object_3, IN[1]=getParameterValueByName)  # CPython3
# ---------- python_script_2.python (18 lines) ----------
# Carga las bibliotecas de DesignScript y normas de Python.
import sys
import clr
clr.AddReference('ProtoGeometry')
from Autodesk.DesignScript.Geometry import *

# Las entradas de este nodo se almacenan como lista en las variables IN.
dataEnteringNode = IN

A = IN[0]
B = IN[1]

if A == "true":
    OUT = [b / 4 for b in B]
elif A == "false":
    OUT = [-b / 4 for b in B]
else:
    OUT = "Colocar bien elementos"
# ----------------------------------------

# group: TRASLADO DE GEOMETRIA I - INTERIOR
getLocation = Element.GetLocation(element=flatten_2)
facingOrientation = FamilyInstance.FacingOrientation(familyInstance=flatten_2)
translate = Geometry.Translate(geometry=getLocation, direction=facingOrientation, distance=python_script_2)

code_block_17 = CodeBlock(ESPESOR=getParameterValueByName) { ESPESOR/2; }

# group: TRASLADO DE GEOMETRIA II
rotate = Vector.Rotate(vector=facingOrientation, axis=code_block_16.out1, degrees=code_block_16.out2)
translate_2 = Geometry.Translate(geometry=translate, direction=rotate, distance=code_block_16.out0)
reverse = Vector.Reverse(vector=rotate)
translate_3 = Geometry.Translate(geometry=translate_2, direction=reverse, distance=getParameterValueByName_2)
byStartPointEndPoint = Line.ByStartPointEndPoint(startPoint=translate_2, endPoint=translate_3)
ZAxis = Vector.ZAxis()
byThickeningCurveNormal = PolyCurve.ByThickeningCurveNormal(curve=byStartPointEndPoint, thickness=code_block_17, normal=ZAxis)
watch_2 = Watch(byThickeningCurveNormal)
watch_3d = Watch3D(byThickeningCurveNormal)

levels = Levels("Level 1")

# group: MODELADO DE SUELOS
finishBoundary = Room.FinishBoundary(room=code_block_15)
byJoinedCurves = PolyCurve.ByJoinedCurves(curves=finishBoundary)
flatten_3 = List.Flatten(list=byJoinedCurves)
code_block_18 = CodeBlock { true; }
count = List.Count(list=flatten_2)
cycle = List.Cycle(list=code_block_18, amount=count)
filterByBoolMask_2 = List.FilterByBoolMask(list=byThickeningCurveNormal, mask=cycle@L2)
doesIntersect = Geometry.DoesIntersect(geometry=flatten_3@L2, other=filterByBoolMask_2.in)
firstItem_2 = List.FirstItem(list=doesIntersect)
filterByBoolMask_3 = List.FilterByBoolMask(list=filterByBoolMask_2.in, mask=firstItem_2)
addItemToFront = List.AddItemToFront(item=flatten_3, list=filterByBoolMask_3.in, lacing=Longest)
byPatch = Surface.ByPatch(closedCurve=addItemToFront)
byJoinedSurfaces = PolySurface.ByJoinedSurfaces(surfaces=byPatch)
perimeterCurves = Surface.PerimeterCurves(surface=byJoinedSurfaces)
byJoinedCurves_2 = PolyCurve.ByJoinedCurves(curves=perimeterCurves)
byOutlineTypeAndLevel = Floor.ByOutlineTypeAndLevel(outline=byJoinedCurves_2, floorType=code_block_14.out1, level=levels)
code_block_19 = CodeBlock {  }

# group (continued): TRASLADO DE GEOMETRIA II
watch_3d_2 = Watch3D(byJoinedCurves_2)

code_block_20 = CodeBlock(A=code_block_14.out1) { A.Name; }
setParameterByName = Element.SetParameterByName(element=code_block_15, parameterName=code_block_14.out2, value=code_block_20)
flatten_4 = List.Flatten(list=code_block_14.out0)
code_block_21 = CodeBlock { 1; }
getItemAtIndex = List.GetItemAtIndex(list=flatten_4, index=code_block_21)
code_block_22 = CodeBlock(ROOM=getItemAtIndex) { ROOM; }

# group: PUERTAS
select_phase_2 = RevitPhases()  # nothing selected
doors_2 = Custom[Room.Doors](room=code_block_22, phase=select_phase_2)
flatten_5 = List.Flatten(list=doors_2)

string_from_object_4 = FromObject(object=code_block_14.out3)
python_script_3 = Python()  # IronPython2; unwired: IN[0]; same code as python_script

# group: DATOS DE ENTRADA
getHost_2 = FamilyInstance.GetHost(familyInstance=flatten_5)
elementType_3 = Element.ElementType(element=getHost_2)
getParameterValueByName_3 = Element.GetParameterValueByName(element=elementType_3, parameterName=python_script_3)
elementType_4 = Element.ElementType(element=flatten_5)
getParameterValueByName_4 = Element.GetParameterValueByName(element=elementType_4, parameterName=python_script_3)
code_block_23 = CodeBlock(w=getParameterValueByName_4) { w/2; Vector.ZAxis(); 90; }

python_script_4 = Python(IN[0]=string_from_object_4, IN[1]=getParameterValueByName_3)  # CPython3; same code as python_script_2

# group: TRASLADO DE GEOMETRIA I - INTERIOR
getLocation_2 = Element.GetLocation(element=flatten_5)
facingOrientation_2 = FamilyInstance.FacingOrientation(familyInstance=flatten_5)
translate_4 = Geometry.Translate(geometry=getLocation_2, direction=facingOrientation_2, distance=python_script_4)

code_block_24 = CodeBlock(ESPESOR=getParameterValueByName_3) { ESPESOR/2; }

# group: TRASLADO DE GEOMETRIA II
rotate_2 = Vector.Rotate(vector=facingOrientation_2, axis=code_block_23.out1, degrees=code_block_23.out2)
translate_5 = Geometry.Translate(geometry=translate_4, direction=rotate_2, distance=code_block_23.out0)
reverse_2 = Vector.Reverse(vector=rotate_2)
translate_6 = Geometry.Translate(geometry=translate_5, direction=reverse_2, distance=getParameterValueByName_4)
byStartPointEndPoint_2 = Line.ByStartPointEndPoint(startPoint=translate_5, endPoint=translate_6)
ZAxis_2 = Vector.ZAxis()
byThickeningCurveNormal_2 = PolyCurve.ByThickeningCurveNormal(curve=byStartPointEndPoint_2, thickness=code_block_24, normal=ZAxis_2)
watch_3 = Watch(byThickeningCurveNormal_2)
watch_3d_3 = Watch3D(byThickeningCurveNormal_2)

levels_2 = Levels("Level 1")

# group: MODELADO DE SUELOS
finishBoundary_2 = Room.FinishBoundary(room=code_block_22)
byJoinedCurves_3 = PolyCurve.ByJoinedCurves(curves=finishBoundary_2)
flatten_6 = List.Flatten(list=byJoinedCurves_3)
code_block_25 = CodeBlock { true; }
count_2 = List.Count(list=flatten_5)
cycle_2 = List.Cycle(list=code_block_25, amount=count_2)
filterByBoolMask_4 = List.FilterByBoolMask(list=byThickeningCurveNormal_2, mask=cycle_2@L2)
doesIntersect_2 = Geometry.DoesIntersect(geometry=flatten_6@L2, other=filterByBoolMask_4.in)
firstItem_3 = List.FirstItem(list=doesIntersect_2)
filterByBoolMask_5 = List.FilterByBoolMask(list=filterByBoolMask_4.in, mask=firstItem_3)
addItemToFront_2 = List.AddItemToFront(item=flatten_6, list=filterByBoolMask_5.in, lacing=Longest)
byPatch_2 = Surface.ByPatch(closedCurve=addItemToFront_2)
byJoinedSurfaces_2 = PolySurface.ByJoinedSurfaces(surfaces=byPatch_2)
perimeterCurves_2 = Surface.PerimeterCurves(surface=byJoinedSurfaces_2)
byJoinedCurves_4 = PolyCurve.ByJoinedCurves(curves=perimeterCurves_2)
byOutlineTypeAndLevel_2 = Floor.ByOutlineTypeAndLevel(outline=byJoinedCurves_4, floorType=code_block_14.out1, level=levels_2)
code_block_26 = CodeBlock {  }

# group (continued): TRASLADO DE GEOMETRIA II
watch_3d_4 = Watch3D(byJoinedCurves_4)

code_block_27 = CodeBlock(A=code_block_14.out1) { A.Name; }
setParameterByName_2 = Element.SetParameterByName(element=code_block_22, parameterName=code_block_14.out2, value=code_block_27)
flatten_7 = List.Flatten(list=code_block_14.out0)
code_block_28 = CodeBlock { 2; }
getItemAtIndex_2 = List.GetItemAtIndex(list=flatten_7, index=code_block_28)
code_block_29 = CodeBlock(ROOM=getItemAtIndex_2) { ROOM; }
code_block_30 = CodeBlock(A=code_block_14.out1) { A.Name; }
setParameterByName_3 = Element.SetParameterByName(element=code_block_29, parameterName=code_block_14.out2, value=code_block_30)

# group: PUERTAS
select_phase_3 = RevitPhases()  # nothing selected
doors_3 = Custom[Room.Doors](room=code_block_29, phase=select_phase_3)
flatten_8 = List.Flatten(list=doors_3)

string_from_object_5 = FromObject(object=code_block_14.out3)
python_script_5 = Python()  # IronPython2; unwired: IN[0]; same code as python_script

# group: DATOS DE ENTRADA
getHost_3 = FamilyInstance.GetHost(familyInstance=flatten_8)
elementType_5 = Element.ElementType(element=getHost_3)
getParameterValueByName_5 = Element.GetParameterValueByName(element=elementType_5, parameterName=python_script_5)
elementType_6 = Element.ElementType(element=flatten_8)
getParameterValueByName_6 = Element.GetParameterValueByName(element=elementType_6, parameterName=python_script_5)
code_block_31 = CodeBlock(w=getParameterValueByName_6) { w/2; Vector.ZAxis(); 90; }

python_script_6 = Python(IN[0]=string_from_object_5, IN[1]=getParameterValueByName_5)  # CPython3; same code as python_script_2

# group: TRASLADO DE GEOMETRIA I - INTERIOR
getLocation_3 = Element.GetLocation(element=flatten_8)
facingOrientation_3 = FamilyInstance.FacingOrientation(familyInstance=flatten_8)
translate_7 = Geometry.Translate(geometry=getLocation_3, direction=facingOrientation_3, distance=python_script_6)

code_block_32 = CodeBlock(ESPESOR=getParameterValueByName_5) { ESPESOR/2; }

# group: TRASLADO DE GEOMETRIA II
rotate_3 = Vector.Rotate(vector=facingOrientation_3, axis=code_block_31.out1, degrees=code_block_31.out2)
translate_8 = Geometry.Translate(geometry=translate_7, direction=rotate_3, distance=code_block_31.out0)
reverse_3 = Vector.Reverse(vector=rotate_3)
translate_9 = Geometry.Translate(geometry=translate_8, direction=reverse_3, distance=getParameterValueByName_6)
byStartPointEndPoint_3 = Line.ByStartPointEndPoint(startPoint=translate_8, endPoint=translate_9)
ZAxis_3 = Vector.ZAxis()
byThickeningCurveNormal_3 = PolyCurve.ByThickeningCurveNormal(curve=byStartPointEndPoint_3, thickness=code_block_32, normal=ZAxis_3)
watch_3d_5 = Watch3D(byThickeningCurveNormal_3)
watch_4 = Watch(byThickeningCurveNormal_3)

levels_3 = Levels("Level 1")

# group: MODELADO DE SUELOS
finishBoundary_3 = Room.FinishBoundary(room=code_block_29)
byJoinedCurves_5 = PolyCurve.ByJoinedCurves(curves=finishBoundary_3)
flatten_9 = List.Flatten(list=byJoinedCurves_5)
code_block_33 = CodeBlock { true; }
count_3 = List.Count(list=flatten_8)
cycle_3 = List.Cycle(list=code_block_33, amount=count_3)
filterByBoolMask_6 = List.FilterByBoolMask(list=byThickeningCurveNormal_3, mask=cycle_3@L2)
doesIntersect_3 = Geometry.DoesIntersect(geometry=flatten_9@L2, other=filterByBoolMask_6.in)
firstItem_4 = List.FirstItem(list=doesIntersect_3)
filterByBoolMask_7 = List.FilterByBoolMask(list=filterByBoolMask_6.in, mask=firstItem_4)
addItemToFront_3 = List.AddItemToFront(item=flatten_9, list=filterByBoolMask_7.in, lacing=Longest)
byPatch_3 = Surface.ByPatch(closedCurve=addItemToFront_3)
byJoinedSurfaces_3 = PolySurface.ByJoinedSurfaces(surfaces=byPatch_3)
perimeterCurves_3 = Surface.PerimeterCurves(surface=byJoinedSurfaces_3)
byJoinedCurves_6 = PolyCurve.ByJoinedCurves(curves=perimeterCurves_3)
code_block_34 = CodeBlock {  }
byOutlineTypeAndLevel_3 = Floor.ByOutlineTypeAndLevel(outline=byJoinedCurves_6, floorType=code_block_14.out1, level=levels_3)

# group (continued): TRASLADO DE GEOMETRIA II
watch_3d_6 = Watch3D(byJoinedCurves_6)

flatten_10 = List.Flatten(list=code_block_14.out0)
code_block_35 = CodeBlock { 3; }
getItemAtIndex_3 = List.GetItemAtIndex(list=flatten_10, index=code_block_35)
code_block_36 = CodeBlock(ROOM=getItemAtIndex_3) { ROOM; }
code_block_37 = CodeBlock(A=code_block_14.out1) { A.Name; }
setParameterByName_4 = Element.SetParameterByName(element=code_block_36, parameterName=code_block_14.out2, value=code_block_37)

# group: PUERTAS
select_phase_4 = RevitPhases()  # nothing selected
doors_4 = Custom[Room.Doors](room=code_block_36, phase=select_phase_4)
flatten_11 = List.Flatten(list=doors_4)

string_from_object_6 = FromObject(object=code_block_14.out3)
python_script_7 = Python()  # IronPython2; unwired: IN[0]; same code as python_script

# group: DATOS DE ENTRADA
getHost_4 = FamilyInstance.GetHost(familyInstance=flatten_11)
elementType_7 = Element.ElementType(element=getHost_4)
getParameterValueByName_7 = Element.GetParameterValueByName(element=elementType_7, parameterName=python_script_7)
elementType_8 = Element.ElementType(element=flatten_11)
getParameterValueByName_8 = Element.GetParameterValueByName(element=elementType_8, parameterName=python_script_7)
code_block_38 = CodeBlock(w=getParameterValueByName_8) { w/2; Vector.ZAxis(); 90; }

python_script_8 = Python(IN[0]=string_from_object_6, IN[1]=getParameterValueByName_7)  # CPython3; same code as python_script_2

# group: TRASLADO DE GEOMETRIA I - INTERIOR
getLocation_4 = Element.GetLocation(element=flatten_11)
facingOrientation_4 = FamilyInstance.FacingOrientation(familyInstance=flatten_11)
translate_10 = Geometry.Translate(geometry=getLocation_4, direction=facingOrientation_4, distance=python_script_8)

code_block_39 = CodeBlock(ESPESOR=getParameterValueByName_7) { ESPESOR/2; }

# group: TRASLADO DE GEOMETRIA II
rotate_4 = Vector.Rotate(vector=facingOrientation_4, axis=code_block_38.out1, degrees=code_block_38.out2)
translate_11 = Geometry.Translate(geometry=translate_10, direction=rotate_4, distance=code_block_38.out0)
reverse_4 = Vector.Reverse(vector=rotate_4)
translate_12 = Geometry.Translate(geometry=translate_11, direction=reverse_4, distance=getParameterValueByName_8)
byStartPointEndPoint_4 = Line.ByStartPointEndPoint(startPoint=translate_11, endPoint=translate_12)
ZAxis_4 = Vector.ZAxis()
byThickeningCurveNormal_4 = PolyCurve.ByThickeningCurveNormal(curve=byStartPointEndPoint_4, thickness=code_block_39, normal=ZAxis_4)
watch_3d_7 = Watch3D(byThickeningCurveNormal_4)
watch_5 = Watch(byThickeningCurveNormal_4)

levels_4 = Levels("Level 1")

# group: MODELADO DE SUELOS
finishBoundary_4 = Room.FinishBoundary(room=code_block_36)
byJoinedCurves_7 = PolyCurve.ByJoinedCurves(curves=finishBoundary_4)
flatten_12 = List.Flatten(list=byJoinedCurves_7)
code_block_40 = CodeBlock { true; }
count_4 = List.Count(list=flatten_11)
cycle_4 = List.Cycle(list=code_block_40, amount=count_4)
filterByBoolMask_8 = List.FilterByBoolMask(list=byThickeningCurveNormal_4, mask=cycle_4@L2)
doesIntersect_4 = Geometry.DoesIntersect(geometry=flatten_12@L2, other=filterByBoolMask_8.in)
firstItem_5 = List.FirstItem(list=doesIntersect_4)
filterByBoolMask_9 = List.FilterByBoolMask(list=filterByBoolMask_8.in, mask=firstItem_5)
addItemToFront_4 = List.AddItemToFront(item=flatten_12, list=filterByBoolMask_9.in, lacing=Longest)
byPatch_4 = Surface.ByPatch(closedCurve=addItemToFront_4)
byJoinedSurfaces_4 = PolySurface.ByJoinedSurfaces(surfaces=byPatch_4)
perimeterCurves_4 = Surface.PerimeterCurves(surface=byJoinedSurfaces_4)
byJoinedCurves_8 = PolyCurve.ByJoinedCurves(curves=perimeterCurves_4)
byOutlineTypeAndLevel_4 = Floor.ByOutlineTypeAndLevel(outline=byJoinedCurves_8, floorType=code_block_14.out1, level=levels_4)
code_block_41 = CodeBlock {  }

# group (continued): TRASLADO DE GEOMETRIA II
watch_3d_8 = Watch3D(byJoinedCurves_8)

flatten_13 = List.Flatten(list=code_block_14.out0)
code_block_42 = CodeBlock { 4; }
getItemAtIndex_4 = List.GetItemAtIndex(list=flatten_13, index=code_block_42)
code_block_43 = CodeBlock(ROOM=getItemAtIndex_4) { ROOM; }
code_block_44 = CodeBlock(A=code_block_14.out1) { A.Name; }
setParameterByName_5 = Element.SetParameterByName(element=code_block_43, parameterName=code_block_14.out2, value=code_block_44)

# group: PUERTAS
select_phase_5 = RevitPhases()  # nothing selected
doors_5 = Custom[Room.Doors](room=code_block_43, phase=select_phase_5)
flatten_14 = List.Flatten(list=doors_5)

string_from_object_7 = FromObject(object=code_block_14.out3)
python_script_9 = Python()  # IronPython2; unwired: IN[0]; same code as python_script

# group: DATOS DE ENTRADA
getHost_5 = FamilyInstance.GetHost(familyInstance=flatten_14)
elementType_9 = Element.ElementType(element=getHost_5)
getParameterValueByName_9 = Element.GetParameterValueByName(element=elementType_9, parameterName=python_script_9)
elementType_10 = Element.ElementType(element=flatten_14)
getParameterValueByName_10 = Element.GetParameterValueByName(element=elementType_10, parameterName=python_script_9)
code_block_45 = CodeBlock(w=getParameterValueByName_10) { w/2; Vector.ZAxis(); 90; }

python_script_10 = Python(IN[0]=string_from_object_7, IN[1]=getParameterValueByName_9)  # CPython3; same code as python_script_2

# group: TRASLADO DE GEOMETRIA I - INTERIOR
getLocation_5 = Element.GetLocation(element=flatten_14)
facingOrientation_5 = FamilyInstance.FacingOrientation(familyInstance=flatten_14)
translate_13 = Geometry.Translate(geometry=getLocation_5, direction=facingOrientation_5, distance=python_script_10)

code_block_46 = CodeBlock(ESPESOR=getParameterValueByName_9) { ESPESOR/2; }

# group: TRASLADO DE GEOMETRIA II
rotate_5 = Vector.Rotate(vector=facingOrientation_5, axis=code_block_45.out1, degrees=code_block_45.out2)
translate_14 = Geometry.Translate(geometry=translate_13, direction=rotate_5, distance=code_block_45.out0)
reverse_5 = Vector.Reverse(vector=rotate_5)
translate_15 = Geometry.Translate(geometry=translate_14, direction=reverse_5, distance=getParameterValueByName_10)
byStartPointEndPoint_5 = Line.ByStartPointEndPoint(startPoint=translate_14, endPoint=translate_15)
ZAxis_5 = Vector.ZAxis()
byThickeningCurveNormal_5 = PolyCurve.ByThickeningCurveNormal(curve=byStartPointEndPoint_5, thickness=code_block_46, normal=ZAxis_5)
watch_3d_9 = Watch3D(byThickeningCurveNormal_5)
watch_6 = Watch(byThickeningCurveNormal_5)

levels_5 = Levels("Level 1")

# group: MODELADO DE SUELOS
finishBoundary_5 = Room.FinishBoundary(room=code_block_43)
byJoinedCurves_9 = PolyCurve.ByJoinedCurves(curves=finishBoundary_5)
flatten_15 = List.Flatten(list=byJoinedCurves_9)
code_block_47 = CodeBlock { true; }
count_5 = List.Count(list=flatten_14)
cycle_5 = List.Cycle(list=code_block_47, amount=count_5)
filterByBoolMask_10 = List.FilterByBoolMask(list=byThickeningCurveNormal_5, mask=cycle_5@L2)
doesIntersect_5 = Geometry.DoesIntersect(geometry=flatten_15@L2, other=filterByBoolMask_10.in)
firstItem_6 = List.FirstItem(list=doesIntersect_5)
filterByBoolMask_11 = List.FilterByBoolMask(list=filterByBoolMask_10.in, mask=firstItem_6)
addItemToFront_5 = List.AddItemToFront(item=flatten_15, list=filterByBoolMask_11.in, lacing=Longest)
byPatch_5 = Surface.ByPatch(closedCurve=addItemToFront_5)
byJoinedSurfaces_5 = PolySurface.ByJoinedSurfaces(surfaces=byPatch_5)
perimeterCurves_5 = Surface.PerimeterCurves(surface=byJoinedSurfaces_5)
byJoinedCurves_10 = PolyCurve.ByJoinedCurves(curves=perimeterCurves_5)
byOutlineTypeAndLevel_5 = Floor.ByOutlineTypeAndLevel(outline=byJoinedCurves_10, floorType=code_block_14.out1, level=levels_5)
code_block_48 = CodeBlock {  }

# group (continued): TRASLADO DE GEOMETRIA II
watch_3d_10 = Watch3D(byJoinedCurves_10)
